# Grasshopper definition IPC_Srf Type A.gh (Grasshopper 1.0.7)
# plug-ins: Kangaroo2 Components, LunchBox

brep = Brep(<brep referenced from the Rhino model>)
direction_0_1 = GetInteger(Slider(0, range=0..1), AtLeast=1, AtMost=1, Maximum=2147483647, Minimum=-2147483648, TreeAccess=False)
surface = GetGeometry(brep, AtLeast=1, AtMost=1, DeleteInput=False, Filter=1074004029, TreeAccess=False)
division_1 = GetInteger(Slider(6, range=0..100), AtLeast=1, AtMost=1, Maximum=2147483647, Minimum=-2147483648, TreeAccess=False)
division_2 = GetInteger(Slider(24, range=0..100), AtLeast=1, AtMost=1, Maximum=2147483647, Minimum=-2147483648, TreeAccess=False)
get_boolean = GetBoolean(Button(), AtLeast=1, AtMost=1, FalseValue="False", TreeAccess=False, TrueValue="True")
edges = BrepEdges(Brep=surface)  # -> Naked, Interior, NonManifold
join = JoinCurves(Curves=edges.Naked, Preserve=False)
explode = Explode(Curve=join, Recursive=True)  # -> Segments, Vertices
item = ListItem(List=explode.Segments, Index=direction_0_1, Wrap=True)  # -> Item, Item1, Item2, Item3
flip = FlipCurve(Curve=item.Item2)  # -> Curve, Flag
merge = Merge(Data1=item.Item, Data2=flip.Curve)
divide = DivideCurve(Curve=merge, Count=division_1, Kinks=False)  # -> Points, Tangents, Parameters
flip_2 = FlipMatrix(Data=divide.Points)
pline = PolyLine(Vertices=flip_2, Closed=False)  # -> simplify(Polyline)
panel = Panel("""True
False""")
dispatch = Dispatch(List=flatten(pline), DispatchPattern=panel)  # -> ListA, ListB
divide_2 = DivideCurve(Curve=pline, Count=division_2, Kinks=False)  # -> Points, Tangents, Parameters
divide_3 = DivideCurve(Curve=dispatch.ListA, Count=division_2, Kinks=False)  # -> Points, Tangents, Parameters
divide_4 = DivideCurve(Curve=dispatch.ListB, Count=division_2, Kinks=False)  # -> Points, Tangents, Parameters
relitem = RelativeItem(Tree=simplify(divide_2.Points), Offset="{+1}(+1)", WrapPaths=False, WrapItems=False)  # -> ItemA, ItemB
relitem_2 = RelativeItem(Tree=simplify(divide_2.Points), Offset="{+1}(-1)", WrapPaths=False, WrapItems=False)  # -> ItemA, ItemB
dispatch_2 = Dispatch(List=divide_3.Points, DispatchPattern=panel)  # -> ListA, ListB
dispatch_3 = Dispatch(List=divide_4.Points, DispatchPattern=panel)  # -> ListA, ListB
ln = Line(StartPoint=relitem.ItemA, EndPoint=relitem.ItemB)
ln_2 = Line(StartPoint=relitem_2.ItemA, EndPoint=relitem_2.ItemB)
pt = Point(dispatch_3.ListB)
pt_2 = Point(dispatch_2.ListA)
join_2 = JoinCurves(Curves=flatten(ln), Preserve=False)
join_3 = JoinCurves(Curves=flatten(ln_2), Preserve=False)
cull = CullPattern(List=join_3, CullPattern=panel)
cull_2 = CullPattern(List=join_2, CullPattern=panel)
explode_2 = Explode(Curve=cull_2, Recursive=True)  # -> Segments, Vertices
explode_3 = Explode(Curve=cull, Recursive=True)  # -> Segments, Vertices
pline_2 = PolyLine(Vertices=divide_4.Points, Closed=False)
lng = ListLength(List=explode_2.Segments)
lng_2 = ListLength(List=explode_3.Segments)
explode_4 = Explode(Curve=pline_2, Recursive=True)  # -> Segments, Vertices
equals = Equality(FirstNumber=lng, SecondNumber=1)  # -> Equality, Inequality
equals_2 = Equality(FirstNumber=lng_2, SecondNumber=1)  # -> Equality, Inequality
item_2 = ListItem(List=explode_4.Segments, Index=0, Wrap=True)  # -> Item1, Item
dispatch_4 = Dispatch(List=graft(cull_2), DispatchPattern=equals.Equality)  # -> ListA, ListB
dispatch_5 = Dispatch(List=graft(cull), DispatchPattern=equals_2.Equality)  # -> ListA, ListB
crv = Curve(simplify([item_2.Item1, item_2.Item]))
pline_3 = PolyLine(Vertices=pt_2, Closed=False)
pline_4 = PolyLine(Vertices=pt, Closed=False)
crv_2 = Curve(dispatch_4.ListB)
crv_3 = Curve(dispatch_5.ListB)
explode_5 = Explode(Curve=crv_2, Recursive=True)  # -> Segments, Vertices
explode_6 = Explode(Curve=crv_3, Recursive=True)  # -> Segments, Vertices
explode_7 = Explode(Curve=pline_4, Recursive=True)  # -> Segments, Vertices
explode_8 = Explode(Curve=pline_3, Recursive=True)  # -> Segments, Vertices
end = EndPoints(Curve=[explode_5.Segments, explode_6.Segments, explode_8.Segments, explode_7.Segments])  # -> Start, End
ln_3 = Line(StartPoint=end.Start, EndPoint=end.End)
dupln = RemoveDuplicateLines(Lines=flatten(ln_3), Tolerance=0.01)
context_bake = ContextBake(CrvType2=crv)
context_bake_2 = ContextBake(CrvType1=dupln)
context_print = ContextPrint(Text="20220926_V3")
bake = ObjectBake(
    BakeToggle=get_boolean,
    GeometryObjects=dupln,
    Layer="Crv Type 1",
    ObjectName="Crv Type 1",
    ObjectColor=RGB(255, 255, 255),
    LayerColor=RGB(255, 255, 255))
